# Dynamo graph Toposurface_Create_FromCADMesh(Revit2020).dyn (Dynamo 2.3.0.5885)

# group: Get geometry from linked cad file
selectImportedCADFile = DSModelElementSelection()  # 1 picked in the model; graph input
geometry = Element.Geometry(element=selectImportedCADFile)

# group: Filter meshes
string_from_object = FromObject(obj=geometry)
code_block = CodeBlock(elementtypename=string_from_object, element=geometry) { List.Clean(elementtypename=="Mesh"?element:null,false); }

python_script = Python(IN[0]=code_block)
# ---------- python_script.python (109 lines) ----------
# @maciejwypych

import clr
# Import Element wrapper extension methods
clr.AddReference("RevitNodes")

# Import DesignScript Geometry - uncomment below if necessary
clr.AddReference("ProtoGeometry")
from Autodesk.DesignScript.Geometry import *

clr.AddReference("System")
from System.Collections.Generic import List

# Import Revit elements module
import Revit
clr.ImportExtensions(Revit.Elements)

#Import Conversion libraries between Revit and DesignScript - uncomment below if necessary
clr.ImportExtensions(Revit.GeometryConversion)

# Import DocumentManager and TransactionManager
clr.AddReference("RevitServices")
import RevitServices
from RevitServices.Persistence import DocumentManager
from RevitServices.Transactions import TransactionManager

#An object that represents an open Autodesk Revit project.
doc = DocumentManager.Instance.CurrentDBDocument

#Represents an active session of the Autodesk Revit user interface, providing access to UI customization methods, events, and the active document.
uiapp = DocumentManager.Instance.CurrentUIApplication
#The Application Creation object is used to create new instances of utility objects.
app = uiapp.Application
#An object that represents an Autodesk Revit project opened in the Revit user interface.
uidoc = DocumentManager.Instance.CurrentUIApplication.ActiveUIDocument

# Import RevitAPI
clr.AddReference("RevitAPI")
clr.AddReference('RevitAPIUI')
import Autodesk
from Autodesk.Revit.DB import *
from Autodesk.Revit.UI import *

#Import sys module
import sys
#Specify location path for IronPython install
pyt_path = r'C:\Program Files (x86)\IronPython 2.7\Lib'
sys.path.append(pyt_path)

#The inputs to this node will be stored as a list in the IN variable.
dataEnteringNode = IN

def ProcessList(_func, _list):
    return map( lambda x: ProcessList(_func, x) if type(x)==list else _func(x), _list )

def UnwrapNestedList(e):
	return UnwrapElement(e)
def CreateTopo(e):
	pntsDynamo=e.VertexPositions
	faceind = e.FaceIndices
	pnts = [i.ToXyz() for i in pntsDynamo]
	facets = [PolymeshFacet(i.A,i.B,i.C) for i in faceind]
	

	pntschecked=[]
	verify=[]
	failedpnts=[]
	for ind,i in enumerate(pnts):
		hash = i.X.ToString() + i.Y.ToString()
		if hash in verify:
			newpnt = XYZ(i.X+00000.1,i.Y,i.Z)
			failedpnts.append(pntsDynamo[ind])
			newhash= newpnt.X.ToString() + newpnt.Y.ToString()
			verify.append(newhash)
			pntschecked.append(newpnt)
		else:
			verify.append(hash)
			pntschecked.append(i)
	#Start transaction
	TransactionManager.Instance.EnsureInTransaction(doc)
	#Create topography
	newtopo=Autodesk.Revit.DB.Architecture.TopographySurface.Create(doc,pntschecked,facets)
	#Close transaction
	TransactionManager.Instance.TransactionTaskDone()
	return [newtopo,failedpnts]




if isinstance(IN[0], list):
	inelements = ProcessList(UnwrapNestedList, IN[0])
else:
	inelements = [UnwrapElement(IN[0])]

try:
	errorReport = None
	result = ProcessList(CreateTopo, inelements)

	
except:
	# if error accurs anywhere in the process catch it
	import traceback
	errorReport = traceback.format_exc()

#Assign your output to the OUT variable
if errorReport == None:
	OUT = result
else:
	OUT = errorReport
# ----------------------------------------
transpose = List.Transpose(lists=python_script)
code_block_2 = CodeBlock(a=transpose) { a[0]; }
created_topography = Watch(code_block_2)  # graph output
code_block_3 = CodeBlock(a=transpose) { a[1]; }
modified_points_moved_by_1mm = Watch(code_block_3)  # graph output
